# Grasshopper definition Spheres.gh (Grasshopper 1.0.7)

rectangle = Rectangle(Plane=PlaneXY(0, 0, 0), XSize=Slider(25, range=0..50), YSize=Slider(25, range=0..50), Radius=0)  # -> Rectangle, Length
box_rectangle = BoxRectangle(Rectangle=rectangle.Rectangle, Height=Slider(10, range=0..10))
deconstruct_brep = DeconstructBrep(Brep=box_rectangle)  # -> Faces, Edges, Vertices

# ---- group: RH_IN:count
count = Slider(24, range=0..50)

# ---- group: RH_IN:radius
size = Slider(2, range=0..5)

# ----
list_item = ListItem(List=deconstruct_brep.Faces, Index=Slider(4, range=0..10), Wrap=True)
populate_2d = Populate2D(Region=list_item, Count=count, Seed="1")
mesh_sphere = MeshSphere(Base=populate_2d, Radius=size, UCount=10, VCount=20)
quad_sphere = QuadSphere(Base=populate_2d, Radius=size)

# ---- group: RH_OUT:sphere
data = Data(quad_sphere)
